# Grasshopper definition nesting3d.gh (Grasshopper 1.0.8)
# plug-ins: RhinoCodePluginGH

contenedor = Brep(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)
cajas = Brep([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])
number_slider = Slider(14, range=0..30)
deconstruct_box = DeconstructBox(Box=cajas)  # -> Plane, X, Y, Z
deconstruct_box_2 = DeconstructBox(Box=contenedor)  # -> Plane, X, Y, Z
box_properties = BoxProperties(Box=contenedor)  # -> Center, Diagonal, Area, Volume, Degeneracy
largo = Number(deconstruct_box.X)
ancho = Number(deconstruct_box.Y)
altura = Number(deconstruct_box.Z)
ancho_2 = Number(deconstruct_box_2.Y)
altura_2 = Number(deconstruct_box_2.Z)
largo_2 = Number(deconstruct_box_2.X)

# ---- group: GENERACION POBLACION
python_3_script = Python3Script(
    largo_caja_lista=largo,
    ancho_caja_lista=ancho,
    altura_caja_lista=altura,
    largo_contenedor=largo_2,
    ancho_contenedor=ancho_2,
    altura_contenedor=altura_2,
    origen_contenedor=box_properties.Center,
    poblacion=number_slider)  # -> out, Cajas, Contenedores; inputs largo_caja_lista: list of Double, ancho_caja_lista: list of Double, altura_caja_lista: list of Double, origen_contenedor: Point3d, poblacion: Int32
# ---------- python_3_script: Python ----------
import rhinoscriptsyntax as rs
import Rhino.Geometry as rg
import random
import math

# Función que ajusta la altura de las cajas para que caigan al suelo o sobre otra caja
def ajustar_altura_cajas(cajas, altura_contenedor):
    for caja in cajas:
        caja_bbox = caja.ToBrep().GetBoundingBox(True)
        altura_inicial = caja_bbox.Min.Z
        altura_final = 0  # Altura del suelo

        while True:
            # Verificar si hay colisión con alguna caja debajo de la actual
            colision = False
            for otra_caja in cajas:
                if caja != otra_caja:
                    otra_caja_bbox = otra_caja.ToBrep().GetBoundingBox(True)
                    if (se_solapan_en_x_y(caja_bbox, otra_caja_bbox) and
                        otra_caja_bbox.Max.Z <= caja_bbox.Min.Z):
                        altura_final = otra_caja_bbox.Max.Z  # Toca la caja debajo
                        colision = True
                        break
            
            if colision or altura_inicial <= 0:
                break  # Caja en el suelo o sobre otra caja

            # Mover la caja hacia abajo
            caja.Transform(rg.Transform.Translation(0, 0, -1))
            altura_inicial -= 1

# Función para verificar si dos BoundingBoxes se solapan en el plano XY
def se_solapan_en_x_y(bbox1, bbox2):
    return not (bbox1.Max.X < bbox2.Min.X or bbox1.Min.X > bbox2.Max.X or
                bbox1.Max.Y < bbox2.Min.Y or bbox1.Min.Y > bbox2.Max.Y)

# Función que genera cajas aleatorias dentro de un contenedor
def generar_contenedor_y_cajas(origen_contenedor, largo_contenedor, ancho_contenedor, altura_contenedor, largo_caja_lista, ancho_caja_lista, altura_caja_lista):
    
    # Coordenadas origen contenedor
    contenedor_centro_x = origen_contenedor.X
    contenedor_centro_y = origen_contenedor.Y
    contenedor_centro_z = origen_contenedor.Z

    # Función para verificar si dos BoundingBoxes se solapan
    def verificar_colision(caja1, caja2):
        bbox1 = caja1.ToBrep().GetBoundingBox(True)
        bbox2 = caja2.ToBrep().GetBoundingBox(True)
        
        no_colision_x = bbox1.Max.X < bbox2.Min.X or bbox1.Min.X > bbox2.Max.X
        no_colision_y = bbox1.Max.Y < bbox2.Min.Y or bbox1.Min.Y > bbox2.Max.Y
        no_colision_z = bbox1.Max.Z < bbox2.Min.Z or bbox1.Min.Z > bbox2.Max.Z

        return not (no_colision_x or no_colision_y or no_colision_z)

    # Función para verificar si la caja está completamente dentro del contenedor
    def verificar_dentro_contenedor(caja, contenedor_centro_x, contenedor_centro_y, contenedor_centro_z, largo_contenedor, ancho_contenedor, altura_contenedor):
        esquinas = caja.GetCorners()
        
        for esquina in esquinas:
            if not (contenedor_centro_x - largo_contenedor / 2 <= esquina.X <= contenedor_centro_x + largo_contenedor / 2 and
                    contenedor_centro_y - ancho_contenedor / 2 <= esquina.Y <= contenedor_centro_y + ancho_contenedor / 2 and
                    contenedor_centro_z - altura_contenedor / 2 <= esquina.Z <= contenedor_centro_z + altura_contenedor / 2):
                return False
        
        return True

    # Función para generar una caja aleatoria sin colisiones dentro del contenedor
    def generar_caja_aleatoria_sin_colision(cajas_existentes, contenedor_centro_x, contenedor_centro_y, contenedor_centro_z, largo_contenedor, ancho_contenedor, altura_contenedor, largo_caja, ancho_caja, altura_caja):
        intentos = 0
        max_intentos = 100

        while intentos < max_intentos:
            x = random.uniform(contenedor_centro_x - largo_contenedor / 2 + largo_caja / 2, contenedor_centro_x + largo_contenedor / 2 - largo_caja / 2)
            y = random.uniform(contenedor_centro_y - ancho_contenedor / 2 + ancho_caja / 2, contenedor_centro_y + ancho_contenedor / 2 - ancho_caja / 2)
            z = random.uniform(contenedor_centro_z - altura_contenedor / 2 + altura_caja / 2, contenedor_centro_z + altura_contenedor / 2 - altura_caja / 2)
            
            punto_origen = rg.Point3d(x, y, z)
            caja = rg.Box(rg.Plane(punto_origen, rg.Vector3d.ZAxis), rg.Interval(0, largo_caja), rg.Interval(0, ancho_caja), rg.Interval(0, altura_caja))
        
            rot_x = random.choice([0, 90, 180, 270])
            rot_y = random.choice([0, 90, 180, 270])
            rot_z = random.choice([0, 90, 180, 270])

            if rot_x != 0:
                rotacion_x = rg.Transform.Rotation(math.radians(rot_x), rg.Vector3d.XAxis, punto_origen)
                caja.Transform(rotacion_x)
            
            if rot_y != 0:
                rotacion_y = rg.Transform.Rotation(math.radians(rot_y), rg.Vector3d.YAxis, punto_origen)
                caja.Transform(rotacion_y)
            
            if rot_z != 0:
                rotacion_z = rg.Transform.Rotation(math.radians(rot_z), rg.Vector3d.ZAxis, punto_origen)
                caja.Transform(rotacion_z)
            
            if not verificar_dentro_contenedor(caja, contenedor_centro_x, contenedor_centro_y, contenedor_centro_z, largo_contenedor, ancho_contenedor, altura_contenedor):
                intentos += 1
                continue
            
            colision = False
            for caja_existente in cajas_existentes:
                if verificar_colision(caja, caja_existente):
                    colision = True
                    break

            if not colision:
                return caja

            intentos += 1
        
        return None

    # Generar el contenedor centrado en el origen
    contenedor = rg.Box(rg.Plane(origen_contenedor, rg.Vector3d.ZAxis), 
                        rg.Interval(-largo_contenedor / 2, largo_contenedor / 2), 
                        rg.Interval(-ancho_contenedor / 2, ancho_contenedor / 2), 
                        rg.Interval(-altura_contenedor / 2, altura_contenedor / 2))
    
    # Lista para almacenar las cajas generadas
    Cajas = []

    # Generar todas las cajas
    for largo_caja, ancho_caja, altura_caja in zip(largo_caja_lista, ancho_caja_lista, altura_caja_lista):
        caja = generar_caja_aleatoria_sin_colision(Cajas, contenedor_centro_x, contenedor_centro_y, contenedor_centro_z, 
                                                   largo_contenedor, ancho_contenedor, altura_contenedor, 
                                                   largo_caja, ancho_caja, altura_caja)
        
        if caja is not None:
            Cajas.append(caja)
        else:
            print(f"No se pudo generar una caja sin colisiones para las dimensiones: {largo_caja}, {ancho_caja}, {altura_caja}")

    # Ajustar las alturas de las cajas
    ajustar_altura_cajas(Cajas, altura_contenedor)

    # Retornar las cajas y el contenedor
    return Cajas, contenedor



# Lista para almacenar las cajas y contenedores generados
contenedores_y_cajas = []
Cajas=[]
Contenedores=[]

# Generar 10 contenedores y sus respectivas cajas
for i in range(poblacion):
    # Mover el origen del contenedor hacia arriba en Y para cada iteración
    origen_contenedor_nuevo = rg.Point3d(origen_contenedor.X, origen_contenedor.Y + (ancho_contenedor + 500) * i, origen_contenedor.Z)
    
    # Generar el contenedor y sus cajas
    cajas, contenedor = generar_contenedor_y_cajas(origen_contenedor_nuevo, largo_contenedor, ancho_contenedor, altura_contenedor, largo_caja_lista, ancho_caja_lista, altura_caja_lista)
    
    # Guardar en la lista
    contenedores_y_cajas.append((cajas, contenedor))
    Cajas.append(cajas)
    Contenedores.append(contenedor)
# ---------- end python_3_script ----------
c_script = CSharpScript(cajas=simplify(python_3_script.Cajas), contenedores=python_3_script.Contenedores)  # -> out, simplify(Cajas), simplify(graft(Contenedores))
# ---------- c_script: C# ----------
// Grasshopper Script Instance
#region Usings
using System;
using System.Linq;
using System.Collections;
using System.Collections.Generic;
using System.Drawing;

using Rhino;
using Rhino.Geometry;

using Grasshopper;
using Grasshopper.Kernel;
using Grasshopper.Kernel.Data;
using Grasshopper.Kernel.Types;
#endregion

public class Script_Instance : GH_ScriptInstance
{
    #region Notes
    /* 
      Members:
        RhinoDoc RhinoDocument
        GH_Document GrasshopperDocument
        IGH_Component Component
        int Iteration

      Methods (Virtual & overridable):
        Print(string text)
        Print(string format, params object[] args)
        Reflect(object obj)
        Reflect(object obj, string method_name)
    */
    #endregion

    private void RunScript(
	object cajas,
	object contenedores,
	ref object Cajas,
	ref object Contenedores)
    {

        Cajas=cajas;
        Contenedores=contenedores;



    }
}
# ---------- end c_script ----------

# ----
brep = Brep(c_script.Cajas)
brep_2 = Brep(c_script.Contenedores)
param_viewer = ParamViewer(c_script.Cajas)
cluster = Cluster_2(
    cajas=c_script.Cajas,
    contenedores=c_script.Contenedores,
    volumen_contenedor=box_properties.Volume,
    poblacion=number_slider)  # -> cajas_2, contenedores_seleccionadas, volumen_bb_2
panel = Panel(cluster.volumen_bb_2)
tree_branch = TreeBranch(Tree=c_script.Cajas, Path=Slider(13, range=0..13), MaintainPaths=True)
cluster_2 = Cluster_2(
    cajas=cluster.cajas_2,
    contenedores=cluster.contenedores_seleccionadas,
    volumen_contenedor=box_properties.Volume,
    poblacion=number_slider)  # -> cajas_2, contenedores_seleccionadas, volumen_bb_2
panel_2 = Panel(cluster_2.volumen_bb_2)
cluster_3 = Cluster_2(
    cajas=cluster_2.cajas_2,
    contenedores=cluster_2.contenedores_seleccionadas,
    volumen_contenedor=box_properties.Volume,
    poblacion=number_slider)  # -> cajas_2, contenedores_seleccionadas, volumen_bb_2
panel_3 = Panel(cluster_3.volumen_bb_2)
cluster_4 = Cluster_2(
    cajas=cluster_3.cajas_2,
    contenedores=cluster_3.contenedores_seleccionadas,
    volumen_contenedor=box_properties.Volume,
    poblacion=number_slider)  # -> cajas_2, contenedores_seleccionadas, volumen_bb_2
panel_4 = Panel(cluster_4.volumen_bb_2)
cluster_5 = Cluster_2(
    cajas=cluster_4.cajas_2,
    contenedores=cluster_4.contenedores_seleccionadas,
    volumen_contenedor=box_properties.Volume,
    poblacion=number_slider)  # -> cajas_2, contenedores_seleccionadas, volumen_bb_2
panel_5 = Panel(cluster_5.volumen_bb_2)
cluster_6 = Cluster_2(
    cajas=cluster_5.cajas_2,
    contenedores=cluster_5.contenedores_seleccionadas,
    volumen_contenedor=box_properties.Volume,
    poblacion=number_slider)  # -> cajas_2, contenedores_seleccionadas, volumen_bb_2
panel_6 = Panel(cluster_6.volumen_bb_2)
cluster_7 = Cluster_2(
    cajas=cluster_6.cajas_2,
    contenedores=cluster_6.contenedores_seleccionadas,
    volumen_contenedor=box_properties.Volume,
    poblacion=number_slider)  # -> cajas_2, contenedores_seleccionadas, volumen_bb_2
panel_7 = Panel(cluster_7.volumen_bb_2)
cluster_8 = Cluster_2(
    cajas=cluster_7.cajas_2,
    contenedores=cluster_7.contenedores_seleccionadas,
    volumen_contenedor=box_properties.Volume,
    poblacion=number_slider)  # -> cajas_2, contenedores_seleccionadas, volumen_bb_2
panel_8 = Panel(cluster_8.volumen_bb_2)
brep_3 = Brep(cluster_8.cajas_2)

# ==== cluster Cluster_2
poblacion = ClusterInput()
volumen_contenedor = ClusterInput()
poblacion_2 = Number(poblacion)
volumen_contenedor_2 = Number(volumen_contenedor)
cajas = ClusterInput()
contenedores = ClusterInput()
cluster = Cluster(brep=cajas, poblacion=poblacion_2, tree=contenedores, volumen_contenedor=volumen_contenedor_2)  # -> cajas, contenedores_seleccionadas_2, volumen_bb
volumen_bb = Number(cluster.volumen_bb)
volumen_bb_2 = ClusterOutput(volumen_bb)
cluster_2 = Cluster(
    brep=cluster.cajas,
    poblacion=poblacion_2,
    tree=cluster.contenedores_seleccionadas_2,
    volumen_contenedor=volumen_contenedor_2)  # -> cajas, contenedores_seleccionadas_2, volumen_bb
cluster_3 = Cluster(
    brep=cluster_2.cajas,
    poblacion=poblacion_2,
    tree=cluster_2.contenedores_seleccionadas_2,
    volumen_contenedor=volumen_contenedor_2)  # -> cajas, contenedores_seleccionadas_2, volumen_bb
cluster_4 = Cluster(
    brep=cluster_3.cajas,
    poblacion=poblacion_2,
    tree=cluster_3.contenedores_seleccionadas_2,
    volumen_contenedor=volumen_contenedor_2)  # -> cajas, contenedores_seleccionadas_2, volumen_bb
cluster_5 = Cluster(
    brep=cluster_4.cajas,
    poblacion=poblacion_2,
    tree=cluster_4.contenedores_seleccionadas_2,
    volumen_contenedor=volumen_contenedor_2)  # -> cajas, contenedores_seleccionadas_2, volumen_bb
cluster_6 = Cluster(
    brep=cluster_5.cajas,
    poblacion=poblacion_2,
    tree=cluster_5.contenedores_seleccionadas_2,
    volumen_contenedor=volumen_contenedor_2)  # -> cajas, contenedores_seleccionadas_2, volumen_bb
cluster_7 = Cluster(
    brep=cluster_6.cajas,
    poblacion=poblacion_2,
    tree=cluster_6.contenedores_seleccionadas_2,
    volumen_contenedor=volumen_contenedor_2)  # -> cajas, contenedores_seleccionadas_2, volumen_bb
cluster_8 = Cluster(
    brep=cluster_7.cajas,
    poblacion=poblacion_2,
    tree=cluster_7.contenedores_seleccionadas_2,
    volumen_contenedor=volumen_contenedor_2)  # -> cajas, contenedores_seleccionadas_2, volumen_bb
cluster_9 = Cluster(
    brep=cluster_6.cajas,
    poblacion=poblacion_2,
    tree=cluster_6.contenedores_seleccionadas_2,
    volumen_contenedor=volumen_contenedor_2)  # -> cajas, contenedores_seleccionadas_2, volumen_bb
cajas_2 = ClusterOutput(cluster_8.cajas)
contenedores_seleccionadas = ClusterOutput(cluster_8.contenedores_seleccionadas_2)
cluster_10 = Cluster(
    brep=cluster_9.cajas,
    poblacion=poblacion_2,
    tree=cluster_9.contenedores_seleccionadas_2,
    volumen_contenedor=volumen_contenedor_2)  # -> cajas, contenedores_seleccionadas_2, volumen_bb

# ==== cluster Cluster
brep = ClusterInput()
brep_2 = Brep(brep)
volumen_contenedor = ClusterInput()

# ---- group: FUNCION DE APTITUD
bounding_box = BoundingBox(Content=brep_2, Plane=PlaneXY(0, 0, 0), UnionBox=True)  # -> Box, Box_2
volume = Volume(Geometry=bounding_box.Box)  # -> flatten(VolumenBB), Centroid
panel = Panel(volume.VolumenBB)
python_3_script = Python3Script(Volumenes_BB=volume.VolumenBB, Volumen_contenedor=volumen_contenedor)  # -> out, Prob_selecc_cajas_lista; inputs Volumenes_BB: list
# ---------- python_3_script: Python ----------
prob_selecc_cajas_lista=[]
aptitudes=[]



Suma_volumenes = sum(Volumenes_BB) #aptitud de toda la poblacion

#loop para sacar la aptitud de cada cromosoma
for volumen in Volumenes_BB:
    aptitud=100-volumen/Volumen_contenedor*100
    aptitudes.append(aptitud)


suma_aptitudes_poblacion=sum(aptitudes)

for aptitud in aptitudes:
    prob_selecc_cajas=aptitud/suma_aptitudes_poblacion*100
    prob_selecc_cajas_lista.append(prob_selecc_cajas)


Prob_selecc_cajas_lista=prob_selecc_cajas_lista
# ---------- end python_3_script ----------
panel_2 = Panel(python_3_script.Prob_selecc_cajas_lista)

# ----
poblacion = ClusterInput()
poblacion_2 = Number(poblacion)
volumen_bb = ClusterOutput(volume.VolumenBB)
tree = ClusterInput()

# ---- group: SELECCION RULETA
series = Series(Start=0, Step=1, Count=poblacion_2)
giro_ruleta = Python3Script(cromosomas=series, probabilidades=python_3_script.Prob_selecc_cajas_lista, numero_seleccionados=poblacion_2)  # -> out, Seleccionados; inputs cromosomas: list, probabilidades: list of Double, numero_seleccionados: Int32
# ---------- giro_ruleta: Python ----------
import random
import numpy as np

def seleccion_por_ruleta(cromosomas, probabilidades, n_selecciones):
    """
    Función para realizar la selección por ruleta.
    
    :param cromosomas: lista con los cromosomas
    :param probabilidades: lista con las probabilidades asociadas a cada cromosoma
    :param n_selecciones: cantidad de cromosomas que se quieren seleccionar
    :return: lista con los cromosomas seleccionados
    """
    # Verificar que las probabilidades suman 1
    #assert sum(probabilidades) == 1, "Las probabilidades deben sumar 1"
    
    # Lista para almacenar los cromosomas seleccionados
    seleccionados = []
    
    # Selección de cromosomas
    for _ in range(n_selecciones):
        # Girar la ruleta (usamos random.choices con las probabilidades dadas)
        seleccionado = random.choices(cromosomas, weights=probabilidades, k=1)[0]
        seleccionados.append(seleccionado)
    
    return seleccionados




Seleccionados = seleccion_por_ruleta(cromosomas, probabilidades, numero_seleccionados)
# ---------- end giro_ruleta ----------
tree_branch_contenedores = TreeBranch(Tree=tree, Path=giro_ruleta.Seleccionados, MaintainPaths=False)
tree_branch_cajas = TreeBranch(Tree=brep_2, Path=giro_ruleta.Seleccionados, MaintainPaths=False)
panel_3 = Panel(giro_ruleta.Seleccionados)
contenedores_seleccionadas = Brep(tree_branch_contenedores)
cajas_seleccionadas = Brep(tree_branch_cajas)

# ---- group: MUTACION
python_3_script_2 = Python3Script(cajas_seleccionadas=cajas_seleccionadas, contenedores_seleccionados=contenedores_seleccionadas)  # -> out, simplify(hijos); inputs cajas_seleccionadas: tree of Box, contenedores_seleccionados: tree of Box
# ---------- python_3_script_2: Python ----------
import rhinoscriptsyntax as rs
import Rhino.Geometry as rg
from Grasshopper import DataTree
from Grasshopper.Kernel.Data import GH_Path
import random
import math



def verificar_colision(caja1, caja2):
    bbox1 = caja1.ToBrep().GetBoundingBox(True)
    bbox2 = caja2.ToBrep().GetBoundingBox(True)
        
    no_colision_x = bbox1.Max.X < bbox2.Min.X or bbox1.Min.X > bbox2.Max.X
    no_colision_y = bbox1.Max.Y < bbox2.Min.Y or bbox1.Min.Y > bbox2.Max.Y
    no_colision_z = bbox1.Max.Z < bbox2.Min.Z or bbox1.Min.Z > bbox2.Max.Z

    return not (no_colision_x or no_colision_y or no_colision_z)

# Obtener las posiciones de los centros de las cajas y contenedores
def obtener_centro(bbox):
    # Devuelve el centro de un BoundingBox
    return bbox.Center

# Función para calcular el volumen de una caja
def calcular_volumen_caja(caja):
    return caja.Volume

def data_tree_a_lista(data_tree):
    lista = []
    for path in data_tree.Paths:
        rama = data_tree.Branch(path)
        lista.extend(rama)  # Agregar todos los elementos de la rama a la lista
    return lista

def eliminar_duplicado_por_volumen(cajas):
    volúmenes_vistos = {}
    cajas_a_eliminar = []
    
    # Recorre todas las cajas
    for caja in cajas:
        volumen = calcular_volumen_caja(caja)
        
        if volumen in volúmenes_vistos:
            # Marca la caja actual para eliminarla
            cajas_a_eliminar.append(caja)
        else:
            # Guarda la caja en el diccionario de volúmenes vistos
            volúmenes_vistos[volumen] = caja
    
    # Elimina una caja por cada volumen duplicado encontrado
    for caja in cajas_a_eliminar:
        cajas.remove(caja)
    
    return cajas

   ############################3
Hijos_corregidos_total=[]
def cruces_por_pares(cajas_seleccionadas,contenedores_seleccionados):
    Hijos_corregidos =[]
    # Supongamos que 'cajas_seleccionadas' y 'contenedores_seleccionados' son DataTree
    # Vamos a crear dos nuevos DataTree para los hijos
    
    for i in range(0, cajas_seleccionadas.BranchCount - 1, 2):
        hijo_0 = DataTree[rg.Box]()
        hijo_1 = DataTree[rg.Box]()
        grupo_cajas_0 = cajas_seleccionadas.Branch(i)   # Grupo i
        grupo_cajas_1 = cajas_seleccionadas.Branch(i+1) # Grupo i+1
        contenedor0 = contenedores_seleccionados.Branch(i)[0]   # Contenedor del Grupo i
        contenedor1 = contenedores_seleccionados.Branch(i+1)[0]

        # Seleccionar una caja aleatoria del grupo 0
        indice_aleatorio = random.randint(0, len(grupo_cajas_0) - 1)
        caja_aleatoria_grupo_0 = grupo_cajas_0[indice_aleatorio]

        # Calcular el volumen de la caja seleccionada
        volumen_caja_0 = calcular_volumen_caja(caja_aleatoria_grupo_0)

        # Margen de tolerancia para la comparación
        tolerancia = 0.0001

            # Buscar una caja en el grupo 1 que tenga un volumen equivalente dentro del margen de tolerancia
        caja_equivalente_grupo_1 = None
        indice_caja_1 = None
        for i, caja in enumerate(grupo_cajas_1):
            if abs(calcular_volumen_caja(caja) - volumen_caja_0) < tolerancia:
                caja_equivalente_grupo_1 = caja
                indice_caja_1 = i
                break

        # Comprobar si se encontró una caja equivalente en el grupo 1
        if caja_equivalente_grupo_1 is not None:
            print(f"Caja seleccionada de Grupo 0: {caja_aleatoria_grupo_0}")
            print(f"Caja equivalente encontrada en Grupo 1: {caja_equivalente_grupo_1}")

            # Obtener los BoundingBoxes de las cajas y contenedores
            bbox_caja_0 = caja_aleatoria_grupo_0.BoundingBox
            bbox_caja_1 = caja_equivalente_grupo_1.BoundingBox
            bbox_contenedor_0 = contenedor0.BoundingBox
            bbox_contenedor_1 = contenedor1.BoundingBox

            # Obtener los centros de las cajas y contenedores
            centro_caja_0 = obtener_centro(bbox_caja_0)
            centro_caja_1 = obtener_centro(bbox_caja_1)
            centro_contenedor_0 = obtener_centro(bbox_contenedor_0)
            centro_contenedor_1 = obtener_centro(bbox_contenedor_1)

            # Calcular las posiciones relativas de las cajas en sus respectivos contenedores
            posicion_relativa_0 = rg.Vector3d(centro_caja_0) - rg.Vector3d(centro_contenedor_0)
            posicion_relativa_1 = rg.Vector3d(centro_caja_1) - rg.Vector3d(centro_contenedor_1)

            # Crear nuevas instancias de las cajas (copiar)
            caja_nueva_0 = rg.Box(caja_aleatoria_grupo_0.Plane, caja_aleatoria_grupo_0.BoundingBox)
            caja_nueva_1 = rg.Box(caja_equivalente_grupo_1.Plane, caja_equivalente_grupo_1.BoundingBox)

            # Ahora aplicamos las posiciones relativas de las cajas cruzadas a los contenedores opuestos
            nueva_posicion_caja_0 = rg.Point3d(centro_contenedor_1) + posicion_relativa_0  # Caja 0 dentro del contenedor 1
            nueva_posicion_caja_1 = rg.Point3d(centro_contenedor_0) + posicion_relativa_1  # Caja 1 dentro del contenedor 0

            # Aplicar las nuevas transformaciones de traslación para mover las cajas a sus nuevas posiciones
            transformacion_0 = rg.Transform.Translation(nueva_posicion_caja_0 - centro_caja_0)
            transformacion_1 = rg.Transform.Translation(nueva_posicion_caja_1 - centro_caja_1)

            caja_nueva_0.Transform(transformacion_0)
            caja_nueva_1.Transform(transformacion_1)

            # Crear los hijos con las cajas intercambiadas en sus posiciones relativas
            for i, caja in enumerate(grupo_cajas_0):
                if i == indice_aleatorio:
                    hijo_0.Add(caja_nueva_1, GH_Path(0))  # Añadir la caja transformada del grupo 1
                else:
                    hijo_0.Add(caja, GH_Path(0))  # Añadir las demás cajas del grupo 0

            for i, caja in enumerate(grupo_cajas_1):
                if i == indice_caja_1:
                    hijo_1.Add(caja_nueva_0, GH_Path(0))  # Añadir la caja transformada del grupo 0
                else:
                    hijo_1.Add(caja, GH_Path(0))  # Añadir las demás cajas del grupo 1
        else:
            print("No se encontró una caja equivalente en el Grupo 1.")

        #-------------------
        # Función para verificar si dos BoundingBoxes se solapan
        colision0 = False
        #verificar_colision(caja, caja_existente):
        # Iterar sobre todas las ramas del DataTree
        for path in hijo_0.Paths:
            # Obtener los elementos de la rama actual
            rama = hijo_0.Branch(path)
            # Iterar sobre los elementos de la rama
            for caja in rama:
                # Aquí puedes trabajar con cada 'caja'
                if verificar_colision(caja_nueva_1, caja):
                    if(calcular_volumen_caja(caja_nueva_1)==calcular_volumen_caja(caja)):
                        colision0=False
                    else:
                        colision0 = True
                        break
        print("colision en hijo 0:")
        print(colision0)     

        colision1 = False
        #verificar_colision(caja, caja_existente):
        # Iterar sobre todas las ramas del DataTree
        for path in hijo_1.Paths:
            # Obtener los elementos de la rama actual
            rama = hijo_1.Branch(path)
            # Iterar sobre los elementos de la rama
            for caja in rama:
                # Aquí puedes trabajar con cada 'caja'
                if verificar_colision(caja_nueva_0, caja):
                    if(calcular_volumen_caja(caja_nueva_0)==calcular_volumen_caja(caja)):
                        colision1=False
                    else:
                        colision1 = True
                        break
        print("colision en hijo 1:")
        print(colision1)
        ##################################
        ##############################3
        origen_contenedor0=contenedor0.Center # Contenedor del Grupo 0 (asumiendo que es un único contenedor)
        # Calcular las dimensiones a partir del BoundingBox
        contenedor0_BB=contenedor0.ToBrep()
        contenedor0_BB = contenedor0.ToBrep().GetBoundingBox(True)
        largo_contenedor0 = contenedor0_BB.Max.X - contenedor0_BB.Min.X
        ancho_contenedor0 = contenedor0_BB.Max.Y - contenedor0_BB.Min.Y
        altura_contenedor0 = contenedor0_BB.Max.Z - contenedor0_BB.Min.Z


        caja_nueva_1_BB=caja_nueva_1.ToBrep().GetBoundingBox(True)
        largo_caja_nueva_1 = caja_nueva_1_BB.Max.X - caja_nueva_1_BB.Min.X
        ancho_caja_nueva_1 = caja_nueva_1_BB.Max.Y - caja_nueva_1_BB.Min.Y
        alto_caja_nueva_1 = caja_nueva_1_BB.Max.Z - caja_nueva_1_BB.Min.Z

        largo_caja_lista0=[]
        ancho_caja_lista0=[]
        altura_caja_lista0=[]

        largo_caja_lista0.append(largo_caja_nueva_1)
        ancho_caja_lista0.append(ancho_caja_nueva_1)
        altura_caja_lista0.append(alto_caja_nueva_1)


        hijo_0_lista= data_tree_a_lista(hijo_0)
        ##################################################
        origen_contenedor1=contenedor1.Center # Contenedor del Grupo 0 (asumiendo que es un único contenedor)
        # Calcular las dimensiones a partir del BoundingBox
        contenedor1_BB=contenedor1.ToBrep()
        contenedor1_BB = contenedor1.ToBrep().GetBoundingBox(True)
        largo_contenedor1 = contenedor1_BB.Max.X - contenedor1_BB.Min.X
        ancho_contenedor1 = contenedor1_BB.Max.Y - contenedor1_BB.Min.Y
        altura_contenedor1 = contenedor1_BB.Max.Z - contenedor1_BB.Min.Z


        caja_nueva_0_BB=caja_nueva_0.ToBrep().GetBoundingBox(True)
        largo_caja_nueva_0 = caja_nueva_0_BB.Max.X - caja_nueva_0_BB.Min.X
        ancho_caja_nueva_0 = caja_nueva_0_BB.Max.Y - caja_nueva_0_BB.Min.Y
        alto_caja_nueva_0 = caja_nueva_0_BB.Max.Z - caja_nueva_0_BB.Min.Z

        largo_caja_lista1=[]
        ancho_caja_lista1=[]
        altura_caja_lista1=[]

        largo_caja_lista1.append(largo_caja_nueva_0)
        ancho_caja_lista1.append(ancho_caja_nueva_0)
        altura_caja_lista1.append(alto_caja_nueva_0)


        hijo_1_lista= data_tree_a_lista(hijo_1)

        ##################################################
        def generar_contenedor_y_cajas(Cajas,origen_contenedor, largo_contenedor, ancho_contenedor, altura_contenedor, largo_caja_lista, ancho_caja_lista, altura_caja_lista):
                
                # Coordenadas origen contenedor
                contenedor_centro_x = origen_contenedor.X
                contenedor_centro_y = origen_contenedor.Y
                contenedor_centro_z = origen_contenedor.Z

                # Función para verificar si dos BoundingBoxes se solapan
                def verificar_colision(caja1, caja2):
                    if(calcular_volumen_caja(caja1)==calcular_volumen_caja(caja2)):
                        return False
                    bbox1 = caja1.ToBrep().GetBoundingBox(True)
                    bbox2 = caja2.ToBrep().GetBoundingBox(True)
                    
                    no_colision_x = bbox1.Max.X < bbox2.Min.X or bbox1.Min.X > bbox2.Max.X
                    no_colision_y = bbox1.Max.Y < bbox2.Min.Y or bbox1.Min.Y > bbox2.Max.Y
                    no_colision_z = bbox1.Max.Z < bbox2.Min.Z or bbox1.Min.Z > bbox2.Max.Z

                    return not (no_colision_x or no_colision_y or no_colision_z)

                # Función para verificar si la caja está completamente dentro del contenedor
                def verificar_dentro_contenedor(caja, contenedor_centro_x, contenedor_centro_y, contenedor_centro_z, largo_contenedor, ancho_contenedor, altura_contenedor):
                    esquinas = caja.GetCorners()
                    
                    for esquina in esquinas:
                        if not (contenedor_centro_x - largo_contenedor / 2 <= esquina.X <= contenedor_centro_x + largo_contenedor / 2 and
                                contenedor_centro_y - ancho_contenedor / 2 <= esquina.Y <= contenedor_centro_y + ancho_contenedor / 2 and
                                contenedor_centro_z - altura_contenedor / 2 <= esquina.Z <= contenedor_centro_z + altura_contenedor / 2):
                            return False
                    
                    return True

                # Función para generar una caja aleatoria sin colisiones dentro del contenedor
                def generar_caja_aleatoria_sin_colision(cajas_existentes, contenedor_centro_x, contenedor_centro_y, contenedor_centro_z, largo_contenedor, ancho_contenedor, altura_contenedor, largo_caja, ancho_caja, altura_caja):
                    intentos = 0
                    max_intentos = 100

                    while intentos < max_intentos:
                        x = random.uniform(contenedor_centro_x - largo_contenedor / 2 + largo_caja / 2, contenedor_centro_x + largo_contenedor / 2 - largo_caja / 2)
                        y = random.uniform(contenedor_centro_y - ancho_contenedor / 2 + ancho_caja / 2, contenedor_centro_y + ancho_contenedor / 2 - ancho_caja / 2)
                        z = random.uniform(contenedor_centro_z - altura_contenedor / 2 + altura_caja / 2, contenedor_centro_z + altura_contenedor / 2 - altura_caja / 2)
                        
                        punto_origen = rg.Point3d(x, y, z)
                        caja = rg.Box(rg.Plane(punto_origen, rg.Vector3d.ZAxis), rg.Interval(0, largo_caja), rg.Interval(0, ancho_caja), rg.Interval(0, altura_caja))
                    
                        rot_x = random.choice([0, 90, 180, 270])
                        rot_y = random.choice([0, 90, 180, 270])
                        rot_z = random.choice([0, 90, 180, 270])

                        if rot_x != 0:
                            rotacion_x = rg.Transform.Rotation(math.radians(rot_x), rg.Vector3d.XAxis, punto_origen)
                            caja.Transform(rotacion_x)
                        
                        if rot_y != 0:
                            rotacion_y = rg.Transform.Rotation(math.radians(rot_y), rg.Vector3d.YAxis, punto_origen)
                            caja.Transform(rotacion_y)
                        
                        if rot_z != 0:
                            rotacion_z = rg.Transform.Rotation(math.radians(rot_z), rg.Vector3d.ZAxis, punto_origen)
                            caja.Transform(rotacion_z)
                        
                        if not verificar_dentro_contenedor(caja, contenedor_centro_x, contenedor_centro_y, contenedor_centro_z, largo_contenedor, ancho_contenedor, altura_contenedor):
                            intentos += 1
                            continue
                        
                        colision = False
                        for caja_existente in cajas_existentes:
                            if verificar_colision(caja, caja_existente):
                                colision = True
                                break

                        if not colision:
                            return caja

                        intentos += 1
                    
                    return None

                # Generar el contenedor centrado en el origen
                contenedor = rg.Box(rg.Plane(origen_contenedor, rg.Vector3d.ZAxis), 
                                    rg.Interval(-largo_contenedor / 2, largo_contenedor / 2), 
                                    rg.Interval(-ancho_contenedor / 2, ancho_contenedor / 2), 
                                    rg.Interval(-altura_contenedor / 2, altura_contenedor / 2))
                
                # Lista para almacenar las cajas generadas
                #Cajas = []

                # Generar todas las cajas
                for largo_caja, ancho_caja, altura_caja in zip(largo_caja_lista, ancho_caja_lista, altura_caja_lista):
                    caja = generar_caja_aleatoria_sin_colision(Cajas, contenedor_centro_x, contenedor_centro_y, contenedor_centro_z, 
                                                            largo_contenedor, ancho_contenedor, altura_contenedor, 
                                                            largo_caja, ancho_caja, altura_caja)
                    
                    if caja is not None:
                        i=0
                        toleranciaa=0.1
                        for caja_veri in Cajas:
                            if abs(calcular_volumen_caja(caja_veri)-calcular_volumen_caja(caja))<toleranciaa:
                                Cajas.pop(i)
                                i=0
                                break
                            i+=1
                        Cajas.append(caja)
                    else:
                        print(f"No se pudo generar una caja sin colisiones para las dimensiones: {largo_caja}, {ancho_caja}, {altura_caja}")

                # Ajustar las alturas de las cajas
                #ajustar_altura_cajas(Cajas, altura_contenedor)

                # Retornar las cajas y el contenedor
                return Cajas, contenedor
        #######################################
        if (colision0):
        # Generar el contenedor y sus cajas
            Hijo_0_corregido, contenedor0 = generar_contenedor_y_cajas(hijo_0_lista,origen_contenedor0, largo_contenedor0, ancho_contenedor0, altura_contenedor0, largo_caja_lista0, ancho_caja_lista0, altura_caja_lista0)
            
        else:
            Hijo_0_corregido=data_tree_a_lista(hijo_0)

        if (colision1):
        # Generar el contenedor y sus cajas
            Hijo_1_corregido, contenedor1 = generar_contenedor_y_cajas(hijo_1_lista,origen_contenedor1, largo_contenedor1, ancho_contenedor1, altura_contenedor1, largo_caja_lista1, ancho_caja_lista1, altura_caja_lista1)
            
        else:
            Hijo_1_corregido=data_tree_a_lista(hijo_1)

        Hijos_corregidos.append(Hijo_0_corregido)
        Hijos_corregidos.append(Hijo_1_corregido)

    return Hijos_corregidos

hijos=cruces_por_pares(cajas_seleccionadas,contenedores_seleccionados)
# ---------- end python_3_script_2 ----------
c_script = CSharpScript(cajas=simplify(python_3_script_2.hijos))  # -> out, simplify(Cajas)
# ---------- c_script: C# ----------
// Grasshopper Script Instance
#region Usings
using System;
using System.Linq;
using System.Collections;
using System.Collections.Generic;
using System.Drawing;

using Rhino;
using Rhino.Geometry;

using Grasshopper;
using Grasshopper.Kernel;
using Grasshopper.Kernel.Data;
using Grasshopper.Kernel.Types;
#endregion

public class Script_Instance : GH_ScriptInstance
{
    #region Notes
    /* 
      Members:
        RhinoDoc RhinoDocument
        GH_Document GrasshopperDocument
        IGH_Component Component
        int Iteration

      Methods (Virtual & overridable):
        Print(string text)
        Print(string format, params object[] args)
        Reflect(object obj)
        Reflect(object obj, string method_name)
    */
    #endregion

    private void RunScript(object cajas, ref object Cajas)
    {

        Cajas=cajas;
        



    }
}
# ---------- end c_script ----------
param_viewer = ParamViewer(c_script.Cajas)

# ----
contenedores_seleccionadas_2 = ClusterOutput(contenedores_seleccionadas)
cajas = ClusterOutput(c_script.Cajas)
